# Grasshopper definition SectionModifierTests.gh (Grasshopper 1.0.7)
# Copyright: Arup
# plug-ins: GSA, UnitNumber

profile = CreateProfile(
    Depth_cm="60",
    Width_cm="60",
    NumberOfInputs=2,
    catalogueIndex=-1,
    inclSS=False,
    lengthUnit="Centimeter",
    mode="Other",
    Profile_type="Rectangle",
    Measure="cm",
    typeIndex=-1)
createunit = CreateUnitNumber(Number=Slider(0.7, range=0..1), Unit_type="Ratio", Measure="DecimalFraction")
sectprop = SectionProperties(Section=profile, LengthUnit="Centimeter")  # -> Area_cm², MomentOfInertiaYY_cm⁴, MomentOfInertiaZZ_cm⁴, MomentOfInertiaYZ_cm⁴, TorsionConstant_cm⁴, ShearAreaFactorInY, ShearAreaFactorInZ, SurfaceALength_m²_m, VolumeLength_m³_m
toggle = BooleanToggle(True)
profile_2 = CreateProfile(
    Depth_cm="40",
    Width_cm="40",
    NumberOfInputs=2,
    catalogueIndex=-1,
    inclSS=False,
    lengthUnit="Centimeter",
    mode="Other",
    Profile_type="Rectangle",
    Measure="cm",
    typeIndex=-1)
profile_3 = CreateProfile(
    Depth_cm="40",
    Width_cm="40",
    NumberOfInputs=2,
    catalogueIndex=-1,
    inclSS=False,
    lengthUnit="Centimeter",
    mode="Other",
    Profile_type="Rectangle",
    Measure="cm",
    typeIndex=-1)
sectionmodifier = CreateSectionModifier(
    AreaModifier_cm²=sectprop.Area_cm²,
    I11Modifier_cm⁴=sectprop.MomentOfInertiaYY_cm⁴,
    I22Modifier_cm⁴=sectprop.MomentOfInertiaZZ_cm⁴,
    JModifier_cm⁴=sectprop.TorsionConstant_cm⁴,
    K11Modifier_=sectprop.ShearAreaFactorInY,
    K22Modifier_=sectprop.ShearAreaFactorInZ,
    VolumeModifier_m³_m=sectprop.VolumeLength_m³_m,
    AdditionalMass_kg_m=Slider(500, range=0..1000),
    PrincipalBendingAxis=False,
    ReferencePointCentroid=False,
    Modify_type="Modify to",
    Length_unit="Centimeter",
    Density_unit="kg/m",
    Stress_calc="Use modified",
    toMode=True)
sectionmodifier_2 = CreateSectionModifier(
    AreaModifier=Slider(0.5, range=0..1),
    I11Modifier="105 %",
    I22Modifier=createunit,
    JModifier=Slider(0.3, range=0..1),
    K11Modifier=Slider(0.35, range=0..1),
    K22Modifier=Slider(0.45, range=0..1),
    VolumeModifier=Slider(0.9, range=0..1),
    AdditionalMass_kg_m=Slider(1250, range=0..10000),
    PrincipalBendingAxis=toggle,
    ReferencePointCentroid=toggle,
    Modify_type="Modify by",
    Density_unit="kg/m",
    Stress_calc="Use unmodified",
    toMode=False)
pt = ConstructPoint(XCoordinate=0, YCoordinate=0, ZCoordinate=0)
sectionedit = EditSection(SectionProfile=profile_3, SectionModifier=sectionmodifier)  # -> Section, SectionNumber, SectionProfile, Material, SectionModifier, SectionPool, SectionName, SectionColour
sectionedit_2 = EditSection(SectionProfile=profile_2, SectionModifier=sectionmodifier_2)  # -> Section, SectionNumber, SectionProfile, Material, SectionModifier, SectionPool, SectionName, SectionColour
line = LineSDL(Start=pt, Direction=Vector(0, 0, 1), Length=1)
elem1d = Create1DElement(Line=line, Section=sectionedit.Section)
model = CreateModel(Properties=sectionedit_2.Section, GSAGeometryIn_m=elem1d, ReMesh=True, Tolerance=0.05, Unit="m")
getgeo = GetModelGeometry(GSAModel=model, NodeFilterList="All", ElementFilterList="All", MemberFilterList="All", Mode=1, Unit="m")  # -> Nodes_m, _1DElements_m, _2DElements_m, _3DElements_m, _1DMembers_m, _2DMembers_m, _3DMembers_m
getprops = GetModelProperties(GSAModel=model)  # -> Sections, _2DProperties, _3DProperties
elem1dedit = Edit1DElement(Element1D=getgeo._1DElements_m)  # -> Element1D, Number, Line, Section, Group, Type, Offset, StartRelease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
item = ListItem(List=getprops.Sections, Index=0, Wrap=True)
modifieredit = EditSectionModifier(SectionModifier=item, DensityUnit="KilogramPerMeter", LengthUnit="Centimeter")  # -> SectionModifier, AreaModifier_cm², I11Modifier_cm⁴, I22Modifier_cm⁴, JModifier, K11Modifier, K22Modifier, VolumeModifier_m³_m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
sectionedit_3 = EditSection(Section=elem1dedit.Section)  # -> Section, SectionNumber, SectionProfile, Material, SectionModifier, SectionPool, SectionName, SectionColour

# ---- group: BYbooleans
bool = Boolean([modifieredit.PrincipalBendingAxis, modifieredit.ReferencePointCentroid])

# ---- group: BYvalues
num = Number([modifieredit.AreaModifier_cm², modifieredit.I11Modifier_cm⁴, modifieredit.I22Modifier_cm⁴, modifieredit.JModifier, modifieredit.K11Modifier, modifieredit.K22Modifier, modifieredit.VolumeModifier_m³_m, modifieredit.AdditionalMass_kg_m])

# ---- group: BYstressOption
int = Integer(modifieredit.StressOptionType)

# ----
modifieredit_2 = EditSectionModifier(SectionModifier=sectionedit_3.SectionModifier, DensityUnit="KilogramPerMeter", LengthUnit="Centimeter")  # -> SectionModifier, AreaModifier_cm², I11Modifier_cm⁴, I22Modifier_cm⁴, JModifier, K11Modifier, K22Modifier, VolumeModifier_m³_m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
panel = Panel(num)
panel_2 = Panel(bool)
panel_3 = Panel(int)

# ---- group: TObooleans
bool_2 = Boolean([modifieredit_2.PrincipalBendingAxis, modifieredit_2.ReferencePointCentroid])

# ---- group: TOvalues
num_2 = Number([modifieredit_2.AreaModifier_cm², modifieredit_2.I11Modifier_cm⁴, modifieredit_2.I22Modifier_cm⁴, modifieredit_2.JModifier, modifieredit_2.K11Modifier, modifieredit_2.K22Modifier, modifieredit_2.VolumeModifier_m³_m, modifieredit_2.AdditionalMass_kg_m])

# ---- group: TOstressOption
int_2 = Integer(modifieredit_2.StressOptionType)

# ----
panel_4 = Panel(num_2)
panel_5 = Panel(bool_2)
panel_6 = Panel(int_2)
